# Grasshopper definition capture-test.gh (Grasshopper 0.9.76)
# plug-ins: Capture, Sampler

panel = Panel("C:\Code\gh-design-space-exploration\Sampler\bin\")
number_slider = Slider(5.402, range=1..10)
number_slider_2 = Slider(2.597, range=1..10)
number_slider_3 = Slider(4.401, range=1..10)
sampler = Sampler(
    Variables=[number_slider_2, number_slider, number_slider_3],
    Samples="100",
    Type=0,
    Seed="0",
    Filename="testncb-01",
    Directory=panel)
panel_2 = Panel(sampler)
ma = MassAddition(Input=[number_slider_2, number_slider, number_slider_3])  # -> Result, PartialResults
capture = Capture(
    Variables=[number_slider_2, number_slider, number_slider_3],
    Objectives=ma.Result,
    Mode=0,
    Properties=ma.Result,
    DesignMap=panel_2,
    CsvFilename="data",
    CsvDirectory=panel,
    ScreenshotFilename="screenshot",
    ScreenshotDirectory=panel)  # -> DesignMapObjectives, CapturedProperties
panel_3 = Panel(capture.DesignMapObjectives)
panel_4 = Panel(capture.CapturedProperties)
