# Grasshopper definition cluster-test.gh (Grasshopper 0.9.76)
# plug-ins: Sampler

sampler = Sampler(
    Variables=[Slider(4, range=1..10), Slider(4, range=1..10), Slider(4, range=1..10)],
    Samples="100",
    Type=0,
    Seed="0",
    Prefix="test-01",
    Path="C:\Code\gh-design-space-exploration\Sampler\bin\")
panel = Panel(sampler)
number_slider = Slider(1, range=0..10)
number_slider_2 = Slider(3, range=0..10)
number_slider_3 = Slider(1, range=0..10)
